# Grasshopper definition 250123_UI Connector.ghx (Grasshopper 1.0.8)
# plug-ins: RhinoCodePluginGH

py3 = Python3Script(get_inputs=Toggle(False))  # -> out, element_names, element_geo, element_thik
# ---------- py3: Python ----------
import System.IO as sysIO
import sys
import Grasshopper
import importlib
import scriptcontext as sc
from Grasshopper.Kernel.Data import GH_Path
from Grasshopper import DataTree
from System import Object

# GH path
ghFilePath = Grasshopper.Instances.ActiveDocument.FilePath
ghDirPath = sysIO.Directory.GetParent(ghFilePath)
ghDirPathStr = ghDirPath.ToString()
# Access to ALL python files in the GH file directory as modules
sys.path.append((ghDirPathStr))

import connector
importlib.reload(connector)

if get_inputs:
    myParentDir = ghDirPath.Parent.FullName
    htmlPath = sysIO.Path.Join(myParentDir, "UI\\index.html")

    # Prepare references to the GH doc and component
    gh_doc = Grasshopper.Instances.ActiveCanvas.Document
    thisComp = ghenv.Component

    #myComp = connector.MyComponent()
    result = connector.MyComponent.RunScript(gh_doc, thisComp, get_inputs, htmlPath)
    
    elements = sc.sticky.get("elements", [])
    element_names = DataTree[Object]()
    element_geo = DataTree[Object]()
    element_thik = DataTree[Object]()
    for i, element in enumerate(elements):
        path = GH_Path(i)
        element_names.Add(element.name, path)
        element_thik.Add(element.thickness, path)
        for geo in element.geometries:
            element_geo.Add(geo, path)
# ---------- end py3 ----------
panel = Panel(py3.out)
panel_2 = Panel(py3.element_names)
panel_3 = Panel(py3.element_geo)
panel_4 = Panel(py3.element_thik)
